# Grasshopper definition CT_NEW_UI_Example.gh (Grasshopper 1.0.7)

geo = Geometry([<curve referenced from the Rhino model> x8])
geo_2 = Geometry([<curve referenced from the Rhino model> x3])
geo_3 = Geometry(<curve referenced from the Rhino model>)
geo_4 = Geometry(<curve referenced from the Rhino model>)
beam = CTBeam(Centerline=geo, ZVector=Point(0, 1, 0), Width=0.1, Height=0.1)  # -> Beam, Blank; inputs Centerline: list of Guid, ZVector: list of Vector3d, Width: list, Height: list, Category: list, updateRefObj: Boolean
#   port Centerline: Referenced curve or line, Guid of curve or line in the active Rhino document.
#   port ZVector: Vector defining the orientation of the cross-section (corresponds to the height dimension). If None, a default will be taken.
#   port Width: Width of the cross-section (usually the smaller dimension).
#   port Height: Height of the cross-section (usually the larger dimension).
#   port Category: Category of a beam.
#   port updateRefObj: (optional) If True, the attributes in the referenced object will be updated/overwritten with the new values given here.
#   port Beam: Beam object(s).
#   port Blank: Shape of the beam's blank.
# ---------- beam: Python ----------
"""Creates a Beam from a LineCurve."""
from compas.geometry import Line
from compas.scene import Scene
from compas_rhino.conversions import curve_to_compas
from compas_rhino.conversions import vector_to_compas
from ghpythonlib.componentbase import executingcomponent as component
from Grasshopper.Kernel.GH_RuntimeMessageLevel import Error
from Grasshopper.Kernel.GH_RuntimeMessageLevel import Warning
from Rhino.RhinoDoc import ActiveDoc

from compas_timber.ghpython.rhino_object_name_attributes import update_rhobj_attributes_name
from compas_timber.parts import Beam as CTBeam


class Beam_fromCurve(component):
    def RunScript(self, Centerline, ZVector, Width, Height, Category, updateRefObj):
        # minimum inputs required
        if not Centerline:
            self.AddRuntimeMessage(Warning, "Input parameter 'Centerline' failed to collect data")
        if not Width:
            self.AddRuntimeMessage(Warning, "Input parameter 'Width' failed to collect data")
        if not Height:
            self.AddRuntimeMessage(Warning, "Input parameter 'Height' failed to collect data")

        # reformat unset parameters for consistency
        if not ZVector:
            ZVector = [None]
        if not Category:
            Category = [None]

        Beam = []
        Blank = []
        scene = Scene()

        if Centerline and Height and Width:
            # check list lengths for consistency
            N = len(Centerline)
            if len(ZVector) not in (0, 1, N):
                self.AddRuntimeMessage(
                    Error, " In 'ZVector' I need either none, one or the same number of inputs as the Crv parameter."
                )
            if len(Width) not in (1, N):
                self.AddRuntimeMessage(
                    Error, " In 'W' I need either one or the same number of inputs as the Crv parameter."
                )
            if len(Height) not in (1, N):
                self.AddRuntimeMessage(
                    Error, " In 'H' I need either one or the same number of inputs as the Crv parameter."
                )
            if len(Category) not in (0, 1, N):
                self.AddRuntimeMessage(
                    Error, " In 'Category' I need either none, one or the same number of inputs as the Crv parameter."
                )

            # duplicate data if None or single value
            if len(ZVector) != N:
                ZVector = [ZVector[0] for _ in range(N)]
            if len(Width) != N:
                Width = [Width[0] for _ in range(N)]
            if len(Height) != N:
                Height = [Height[0] for _ in range(N)]
            if len(Category) != N:
                Category = [Category[0] for _ in range(N)]

            for guid, z, w, h, c in zip(Centerline, ZVector, Width, Height, Category):
                curve = curve_to_compas(ActiveDoc.Objects.FindId(guid))
                line = Line(curve.start, curve.end)
                z = vector_to_compas(z) if z else None
                beam = CTBeam.from_centerline(centerline=line, width=w, height=h, z_vector=z)
                beam.attributes["rhino_guid"] = str(guid)
                beam.attributes["category"] = c

                if updateRefObj:
                    update_rhobj_attributes_name(guid, "width", str(w))
                    update_rhobj_attributes_name(guid, "height", str(h))
                    update_rhobj_attributes_name(guid, "zvector", str(list(beam.frame.zaxis)))
                    update_rhobj_attributes_name(guid, "category", c)

                Beam.append(beam)
                scene.add(beam.blank)

        Blank = scene.redraw()

        return Beam, Blank
# ---------- end beam ----------
beam_2 = CTBeam(Centerline=geo_4, Width=0.2, Height=0.2, Category="top")  # -> Beam, Blank; inputs Centerline: list of Guid, ZVector: list of Vector3d, Width: list, Height: list, Category: list, updateRefObj: Boolean; same code as beam
beam_3 = CTBeam(Centerline=geo_2, Width=0.2, Height=0.2)  # -> Beam, Blank; inputs Centerline: list of Guid, ZVector: list of Vector3d, Width: list, Height: list, Category: list, updateRefObj: Boolean; same code as beam
beam_4 = CTBeam(Centerline=geo_3, ZVector=Point(0, 1, 0), Width=0.1, Height=0.1, Category="end")  # -> Beam, Blank; inputs Centerline: list of Guid, ZVector: list of Vector3d, Width: list, Height: list, Category: list, updateRefObj: Boolean; same code as beam
relay = Relay([beam_2.Beam, beam_3.Beam, beam.Beam, beam_4.Beam])
l_miter = CTLMiterJointOptions()  # -> L_Miter
#   port Cutoff: For very acute angles, limit the extension of the tip/beak of the joint.
# ---------- l_miter: Python ----------
from ghpythonlib.componentbase import executingcomponent as component


from compas_timber.connections import LMiterJoint
from compas_timber.ghpython import JointOptions


class LMiterJointOptions(component):
    def RunScript(self, Cutoff):
        args = {"cutoff": Cutoff}
        options = JointOptions(LMiterJoint, **args)

        return options
# ---------- end l_miter ----------

# ----
# Direct Joint Application
directjoint = CT_DirectJointRule(JointOptions=l_miter, Primary_Beam=beam_2.Beam, SecondaryBeam=beam_4.Beam)  # -> Rule; inputs Primary_Beam: list, SecondaryBeam: list
#   port JointOptions: Joint Options Component
# ---------- directjoint: Python ----------
from ghpythonlib.componentbase import executingcomponent as component
from Grasshopper.Kernel.GH_RuntimeMessageLevel import Error
from Grasshopper.Kernel.GH_RuntimeMessageLevel import Warning

from compas_timber.connections import ConnectionSolver
from compas_timber.connections import JointTopology
from compas_timber.ghpython import JointDefinition
from compas_timber.ghpython import DirectRule



class DirectJointRule(component):
    def RunScript(self, JointOptions, MainBeam, SecondaryBeam):
        if not MainBeam:
            self.AddRuntimeMessage(Warning, "Input parameter MainBeams failed to collect data.")
        if not SecondaryBeam:
            self.AddRuntimeMessage(Warning, "Input parameter CrossBeams failed to collect data.")
        if not (MainBeam and SecondaryBeam):
            return
        if not isinstance(MainBeam, list):
            MainBeam = [MainBeam]
        if not isinstance(SecondaryBeam, list):
            SecondaryBeam = [SecondaryBeam]
        if len(MainBeam) != len(SecondaryBeam):
            self.AddRuntimeMessage(Error, "Number of items in MainBeams and CrossBeams must match!")
            return

        print(JointOptions)
        for main, secondary in zip(MainBeam, SecondaryBeam):
            topology, _, _ = ConnectionSolver().find_topology(main, secondary)
            if topology != JointOptions.type.SUPPORTED_TOPOLOGY:
                self.AddRuntimeMessage(
                    Warning,
                    "Beams meet with topology: {} which does not agree with joint of type: {}".format(
                        JointTopology.get_name(topology), JointOptions.type.__name__
                    ),
                )
                continue
            Rule = DirectRule(JointOptions.type, [secondary, main], **JointOptions.kwargs)
        return Rule
# ---------- end directjoint ----------

# ----
# Joint Application By Topology
number_slider = Slider(0.5, range=0..1)

l_butt = CTLButtOptions(SmallBeamButts=Toggle(True))  # -> L_Butt; inputs SmallBeamButts: Boolean
#   port Gap: Gap for tolerance.
# ---------- l_butt: Python ----------
from ghpythonlib.componentbase import executingcomponent as component


from compas_timber.connections import LButtJoint
from compas_timber.ghpython import JointOptions


class LButtJointOptions(component):
    def RunScript(self, Gap, SmallBeamButts):
        args = {"gap": Gap, "small_beam_butts": SmallBeamButts}
        options = JointOptions(LButtJoint, **args)

        return options
# ---------- end l_butt ----------
x_half_lap = CTXHalfLapJointOptions(CutPlaneBias=number_slider)  # -> X_Half_Lap; inputs FlipLapSide: Boolean
#   port FlipLapSide: flips the lap side
# ---------- x_half_lap: Python ----------
from ghpythonlib.componentbase import executingcomponent as component


from compas_timber.connections import XHalfLapJoint
from compas_timber.ghpython import JointOptions


class XHalfLapJointOptions(component):
    def RunScript(self, FlipLap, cut_plane_bias):
        bias = cut_plane_bias or 0.5
        args = {"flip_lap_side": FlipLap, "cut_plane_bias": bias}
        options = JointOptions(XHalfLapJoint, **args)

        return options
# ---------- end x_half_lap ----------

jointsbytopo = CTTopologicalJointRules(L=l_butt, X=x_half_lap)  # -> Joints
#   port L: Joint type to be applied to L topology. Default type is L-Miter. If L-Butt, the beam with a larger cross section area will be used as crossing beam.
# ---------- jointsbytopo: Python ----------
from ghpythonlib.componentbase import executingcomponent as component
from Grasshopper.Kernel.GH_RuntimeMessageLevel import Warning

from compas_timber.connections import JointTopology
from compas_timber.ghpython import TopologyRule

from compas_timber.connections import LMiterJoint
from compas_timber.connections import TButtJoint
from compas_timber.connections import XHalfLapJoint


class MyComponent(component):
    def RunScript(self, L, T, X):
        topoRules = []




        if L:
            if not L.type.SUPPORTED_TOPOLOGY == JointTopology.TOPO_L:
                self.AddRuntimeMessage(Warning, "Joint type does not match topology. Joint may not be generated.")
            topoRules.append(TopologyRule(JointTopology.TOPO_L, L.type, **L.kwargs))
        else:
            topoRules.append(TopologyRule(JointTopology.TOPO_L, LMiterJoint))
        if T:
            if not T.type.SUPPORTED_TOPOLOGY == JointTopology.TOPO_T:
                self.AddRuntimeMessage(Warning, "Joint type does not match topology. Joint may not be generated.")
            topoRules.append(TopologyRule(JointTopology.TOPO_T, T.type, **T.kwargs))
        else:
            topoRules.append(TopologyRule(JointTopology.TOPO_T, TButtJoint))
        if X:
            if not X.type.SUPPORTED_TOPOLOGY == JointTopology.TOPO_X:
                self.AddRuntimeMessage(Warning, "Joint type does not match topology. Joint may not be generated.")
            topoRules.append(TopologyRule(JointTopology.TOPO_X, X.type, **X.kwargs))
        else:
            topoRules.append(TopologyRule(JointTopology.TOPO_X, XHalfLapJoint))

        return topoRules
# ---------- end jointsbytopo ----------

# ----
# Joint Application By Category
toggle = BooleanToggle(True)

l_butt_2 = CTLButtOptions(SmallBeamButts=toggle)  # -> L_Butt; inputs SmallBeamButts: Boolean; same code as l_butt

jointsbycategory = CT_CategoryJointsRules(JointOptions=l_butt_2, CatA="top", CatB="end")  # -> Rule
#   port JointOptions: Joint Options component.
# ---------- jointsbycategory: Python ----------
from ghpythonlib.componentbase import executingcomponent as component

from compas_timber.connections import LButtJoint
from compas_timber.connections import LMiterJoint
from compas_timber.connections import TButtJoint
from compas_timber.connections import XHalfLapJoint
from compas_timber.connections import FrenchRidgeLapJoint
from compas_timber.ghpython import CategoryRule


class CategoryJointRule(component):

    def RunScript(self, JointOptions, CatA, CatB):
        if JointOptions and CatA and CatB:
            return CategoryRule(JointOptions.type, CatA, CatB, **JointOptions.kwargs)
# ---------- end jointsbycategory ----------

relay_2 = Relay([jointsbytopo, jointsbycategory, directjoint])
assembly = CTAssembly(Beams=relay, JointRules=flatten(relay_2), MaxDistance=Slider(0.5, range=0..1), CreateGeometry=Toggle(True))  # -> Assembly, Geometry; inputs Beams: list, JointRules: list, Features: list, CreateGeometry: Boolean
#   port Beams: Collection of Beams
# ---------- assembly: Python ----------
from ghpythonlib.componentbase import executingcomponent as component
from Grasshopper.Kernel.GH_RuntimeMessageLevel import Warning

from compas.scene import Scene
from compas_timber.assembly import TimberAssembly
from compas_timber.consumers import BrepGeometryConsumer
from compas_timber.connections import ConnectionSolver
from compas_timber.connections import JointTopology
from compas_timber.ghpython import JointDefinition
from compas_timber.ghpython import CategoryRule
from compas_timber.ghpython import TopologyRule
from compas_timber.ghpython import DirectRule


class Assembly(component):
    def __init__(self):
        # maintains relationship of old_beam.id => new_beam_obj for referencing
        # lets us modify copies of the beams while referencing them using their old identities.
        self._beam_map = {}

    def _get_copied_beams(self, old_beams):
        """For the given old_beams returns their respective copies."""
        new_beams = []
        for beam in old_beams:
            new_beams.append(self._beam_map[id(beam)])
        return new_beams

    def get_joint_definitions_from_rules(self, beams, rules, MaxDistance = 0):
        if not isinstance(rules, list):
            rules = [rules]
        rules = [r for r in rules if r is not None]

        solver = ConnectionSolver()
        found_pairs = solver.find_intersecting_pairs(beams, rtree=True, max_distance=MaxDistance)
        self.joints = []
        Info = []
        # rules have to be resolved into joint definitions
        topo_rules = {}
        cat_rules = []
        direct_rules = []

        for r in rules:  # separate category and topo and direct joint rules
            if isinstance(r, TopologyRule):
                topo_rules[r.topology_type] = r
            elif isinstance(r, CategoryRule):
                cat_rules.append(r)
            if isinstance(r, DirectRule):
                direct_rules.append(r)

        for pair in found_pairs:
            beam_a, beam_b = pair
            detected_topo, beam_a, beam_b = solver.find_topology(beam_a, beam_b, max_distance=MaxDistance)
            pair_joined = False

            if detected_topo == JointTopology.TOPO_UNKNOWN:
                continue

            for rule in direct_rules:  # apply direct rules first
                if rule.comply(pair):
                    self.joints.append(JointDefinition(rule.joint_type, [beam_a, beam_b], **rule.kwargs))
                    pair_joined = True
                    break

            if not pair_joined:  # if no direct rule applies, apply category rules next
                for rule in cat_rules:
                    if not rule.comply(pair):
                        continue
                    if rule.joint_type.SUPPORTED_TOPOLOGY != detected_topo:
                        msg = "Conflict detected! Beams: {}, {} meet with topology: {} but rule assigns: {}"
                        Info.append(
                            msg.format(beam_a, beam_b, JointTopology.get_name(detected_topo), rule.joint_type.__name__)
                        )
                        continue
                    # sort by category to allow beam role by order (main beam first, cross beam second)
                    beam_a, beam_b = rule.reorder([beam_a, beam_b])
                    self.joints.append(JointDefinition(rule.joint_type, [beam_a, beam_b], **rule.kwargs))
                    break  # first matching rule

                else:  # no category rule applies, apply topology rules
                    if not detected_topo in topo_rules:
                        continue
                    else:
                        self.joints.append(
                            JointDefinition(
                                topo_rules[detected_topo].joint_type, [beam_a, beam_b], **topo_rules[detected_topo].kwargs
                            )
                        )


    def RunScript(self, Beams, JointRules, Features, MaxDistance, CreateGeometry):

        if not Beams:
            self.AddRuntimeMessage(Warning, "Input parameter Beams failed to collect data")
            pass
        if not JointRules:
            self.AddRuntimeMessage(Warning, "Input parameter JointRules failed to collect data")
        if not (Beams and JointRules):
            return

        self.get_joint_definitions_from_rules(Beams, JointRules, MaxDistance=MaxDistance)

        Assembly = TimberAssembly()
        self._beam_map = {}
        beams = [b for b in Beams if b is not None]
        for beam in beams:
            c_beam = beam.copy()
            Assembly.add_beam(c_beam)
            self._beam_map[id(beam)] = c_beam
        beams = Assembly.beams

        if self.joints:
            handled_beams = []
            joints = [j for j in self.joints if j is not None]
            # apply reversed. later joints in orginal list override ealier ones
            for joint in joints[::-1]:
                beams_to_pair = self._get_copied_beams(joint.beams)
                beam_pair_ids = set([id(beam) for beam in beams_to_pair])
                if beam_pair_ids in handled_beams:
                    continue
                joint.joint_type.create(Assembly, *beams_to_pair, **joint.kwargs)
                handled_beams.append(beam_pair_ids)

        if Features:
            features = [f for f in Features if f is not None]
            for f_def in features:
                beams_to_modify = self._get_copied_beams(f_def.beams)
                for beam in beams_to_modify:
                    beam.add_feature(f_def.feature)

        Geometry = None
        scene = Scene()
        if CreateGeometry:
            vis_consumer = BrepGeometryConsumer(Assembly)
            for result in vis_consumer.result:
                scene.add(result.geometry)

        Geometry = scene.redraw()

        return Assembly, Geometry
# ---------- end assembly ----------
bakewithboxmap = CTBakeWithBoxMap(Assembly=assembly.Assembly, Bake=Button())  # inputs MapSize: list, Bake: Boolean
#   port Assembly: Assembly object (optional).
# ---------- bakewithboxmap: Python ----------
# flake8: noqa
import math
import random

from Rhino import Render
from Rhino.Geometry import Plane
from Rhino.Geometry import Interval
from Rhino.RhinoDoc import ActiveDoc
from Grasshopper.Kernel.GH_RuntimeMessageLevel import Warning
from Grasshopper.Kernel.GH_RuntimeMessageLevel import Error
from ghpythonlib.componentbase import executingcomponent as component
import rhinoscriptsyntax as rs

from compas_rhino.conversions import frame_to_rhino
from compas_timber.consumers import BrepGeometryConsumer


class BakeBoxMap(component):
    def RunScript(self, Assembly, MapSize, Bake):
        if MapSize and len(MapSize) != 3:
            self.AddRuntimeMessage(
                Error, "Input parameter MapSize requires exactly three float values (scale factors in x,y,z directions)"
            )
            return

        if MapSize:
            dimx, dimy, dimz = MapSize
        else:
            # for the pine 251 material bitmap, rotated
            dimx = 0.2
            dimy = 0.2
            dimz = 1.0

        if not Assembly:
            self.AddRuntimeMessage(Warning, "Input parameters Assembly failed to collect any Beam objects.")
            return

        if not Bake:
            return

        try:
            geometries = BrepGeometryConsumer(Assembly).result

            frames = [frame_to_rhino(b.frame) for b in Assembly.beams]
            breps = [g.geometry.native_brep for g in geometries]

            if frames and breps:
                rs.EnableRedraw(False)

                for brep, frame in zip(breps, frames):
                    guid = ActiveDoc.Objects.Add(brep)
                    boxmap = self.create_box_map(frame, dimx, dimy, dimz)
                    ActiveDoc.Objects.ModifyTextureMapping(guid, 1, boxmap)
        finally:
            rs.EnableRedraw(True)

    @staticmethod
    def create_box_map(pln, sx, sy, sz):
        """
        pln: frame of beam box, where x=main axis, y=width, z=height
        sx,sy,sz: box map size in x,y,z direction
        """

        v = pln.YAxis
        w = pln.ZAxis
        pt = pln.Origin

        # random deviation
        a = math.pi * 0.5
        randangle = (random.random() - 0.5) * a
        v.Rotate(randangle, pln.XAxis)

        b = math.pi * 0.01
        randangle = (random.random() - 0.5) * b
        w.Rotate(randangle, pln.XAxis)

        randpos = sx * random.random()
        pt += pln.XAxis * randpos

        # create box mapping
        mappingPln = Plane(pt, w, v)
        dx = Interval(-sx * 0.5, sx * 0.5)
        dy = Interval(-sy * 0.5, sy * 0.5)
        dz = Interval(-sz * 0.5, sz * 0.5)

        BoxMap = Render.TextureMapping.CreateBoxMapping(mappingPln, dx, dy, dz, False)

        return BoxMap
# ---------- end bakewithboxmap ----------
showjointtypes = CT_ShowJointTypes(Assembly=assembly.Assembly)
#   port Assembly: Assembly object.
# ---------- showjointtypes: Python ----------
# flake8: noqa
import System
from compas_rhino.conversions import point_to_rhino
from ghpythonlib.componentbase import executingcomponent as component

from compas_timber.utils.compas_extra import intersection_line_line_3D


class ShowJointTypes(component):
    def RunScript(self, Assembly):
        self.pt = []
        self.txt = []

        if not Assembly:
            return

        for joint in Assembly.joints:
            line_a, line_b = joint.beams[0].centerline, joint.beams[1].centerline
            [p1, t1], [p2, t2] = intersection_line_line_3D(line_a, line_b, float("inf"), False, 1e-3)
            p1 = point_to_rhino(p1)
            p2 = point_to_rhino(p2)

            self.pt.append((p2 + p1) / 2)
            self.txt.append(joint.joint_type)

    def DrawViewportWires(self, arg):
        if self.Locked:
            return
        col = System.Drawing.Color.FromArgb(255, 0, 0, 0)
        # https://developer.rhino3d.com/api/RhinoCommon/html/M_Rhino_Display_DisplayPipeline_Draw2dText_5.htm
        for p, t in zip(self.pt, self.txt):
            arg.Display.Draw2dText(t, col, p, True, 12, "Verdana")
# ---------- end showjointtypes ----------
