# Grasshopper definition beam.gh (Grasshopper 1.0.7)

number_slider = Slider(0.12, range=0..1)
number_slider_2 = Slider(0.19, range=0..1)
pt = Point(Point(-1, 0, 0))
vec = Vector(Vector(1.574134825, 0, 0))
pt_2 = Point(Point(0, -1, 0))
vdis = VectorDisplay(Anchor=pt, Vector=vec)
pln = Plane(Plane(origin=(-2, -1, 0), x=(0.4472135955, 0.894427191, 0), y=(-0.4, 0.2, 0.894427191)))
ln = Line(StartPoint=pt, EndPoint=pt_2)
beam_from_line_vec = GhPythonScript(line=ln, vec=vec, W=number_slider, H=number_slider_2)  # -> out, beam, shape; inputs line: Line, vec: Vector3d
# ---------- beam_from_line_vec: Python ----------
__author__ = "aapolina"
__version__ = "2021.12.10"

from compas_ghpython.utilities import unload_modules
import Rhino.Geometry as rg

import compas_timber
reload(compas_timber)
unload_modules('compas_timber')
from compas_timber.elements.beam2 import Beam
from compas_timber.utils.rhino_compas import rVec2cVec, cBox2rBox, rLine2cLine

v = rVec2cVec(vec) 

beam = Beam.from_centreline(rLine2cLine(line),rVec2cVec(vec),W,H)
shape = cBox2rBox(beam.shape)
# ---------- end beam_from_line_vec ----------
beam_from_frame = GhPythonScript(pln=pln, W=number_slider, H=number_slider_2, L=Slider(2.68, range=0..10))  # -> out, beam, shape; inputs pln: Plane
# ---------- beam_from_frame: Python ----------
__author__ = "aapolina"
__version__ = "2021.12.10"

import Rhino.Geometry as rg
from compas_timber.elements.beam2 import Beam
from compas_timber.utils.rhino_compas import rPln2cFrame, cBox2rBox


beam = Beam(rPln2cFrame(pln),L,W,H)

beam = Beam.from_frame(rPln2cFrame(pln),W,H,L)


shape = cBox2rBox(beam.shape)
# ---------- end beam_from_frame ----------
beam_from_points_vec = GhPythonScript(ps=pt, pe=pt_2, vec=vec, W=number_slider, H=number_slider_2)  # -> out, beam, shape; inputs ps: Point3d, pe: Point3d, vec: Vector3d
# ---------- beam_from_points_vec: Python ----------
__author__ = "aapolina"
__version__ = "2021.12.10"

import Rhino.Geometry as rg
from compas_ghpython.utilities import unload_modules


import compas_timber
reload(compas_timber)
unload_modules('compas_timber')
from compas_timber.elements.beam2 import Beam
from compas_timber.utils.rhino_compas import rVec2cVec, rPt2cPt, cBox2rBox

beam = Beam.from_endpoints(rPt2cPt(ps), rPt2cPt(pe), rVec2cVec(vec),W,H)
shape = cBox2rBox(beam.shape)
# ---------- end beam_from_points_vec ----------
