# Grasshopper definition test.gh (Grasshopper 1.0.8)

geo = Geometry(<curve referenced from the Rhino model>)
geo_2 = Geometry(<curve referenced from the Rhino model>)
geo_3 = Geometry(<curve referenced from the Rhino model>)
py3 = Python3Script(cross_line=geo, main_line_a=geo_2, main_line_b=geo_3)  # -> out, a, b, c, d; inputs cross_line: Line, main_line_a: Line, main_line_b: Line
# ---------- py3: Python ----------
#venv: compas_15_timber_dev
#r: compas
#r: compas_model

import importlib

from compas_rhino.devtools import DevTools
DevTools.ensure_path()

from compas_rhino.conversions import *

from compas_timber.connections.k_truss_butt import KTrussButtJoint
from compas_timber.elements import Beam
from compas_timber.model import TimberModel

import compas_timber
import compas
importlib.reload(compas_timber.connections.k_truss_butt)
importlib.reload(compas)



cross_line = line_to_compas(cross_line)
main_line_a = line_to_compas(main_line_a)
main_line_b = line_to_compas(main_line_b)

cross_beam = Beam.from_centerline(cross_line, 20, 30)
beam_a = Beam.from_centerline(main_line_a, 20, 30)
beam_b = Beam.from_centerline(main_line_b, 20, 30)


check = KTrussButtJoint.check_elements_compatibility([cross_beam, beam_a, beam_b], True)
joint = KTrussButtJoint(cross_beam, [beam_a, beam_b], 0)

joint.add_extensions()
joint.add_features()




d = [beam.geometry for beam in joint.beams]
# ---------- end py3 ----------
py3_2 = Python3Script()  # -> out, a
# ---------- py3_2: Python ----------
#venv: new_env_ct_dev2

from compas_rhino.devtools import DevTools

active = True

if active:
    DevTools.enable_reloader()
else:
    DevTools.disable_reloader()
# ---------- end py3_2 ----------
item = ListItem(List=py3.d, Index=0, Wrap=True)  # -> Item, Item1, Item2
draw = COMPASDraw(cg=item.Item)  # -> rg
#   port cg: The COMPAS geometry or datastructure to be drawn.
#   port rg: The Rhino geometry object.
# ---------- draw: Python ----------
# r: compas>=2.14.1
"""
Draws COMPAS geometry in Grasshopper.
"""

from typing import Any

import Grasshopper

from compas.scene import SceneObject


class CompasToRhinoGeometry(Grasshopper.Kernel.GH_ScriptInstance):
    def RunScript(self, cg):
        if not cg:
            return None

        return SceneObject(item=cg).draw()
# ---------- end draw ----------
draw_2 = COMPASDraw(cg=item.Item1)  # -> rg; same code as draw
draw_3 = COMPASDraw(cg=item.Item2)  # -> rg; same code as draw
