# Grasshopper definition test_step_joint.ghx (Grasshopper 1.0.7)
# plug-ins: Human

X = UnitX(Factor=Slider(0, range=0..4000))
Z = UnitZ(Factor=Slider(0, range=0..2000))

# ---- group: MainBeam
flipcurve = BooleanToggle(False)
crv = Curve(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)

# ---- group: CrossBeam
crv_2 = Curve(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)

# ----
end = EndPoints(Curve=crv)  # -> Start, End
addition = Addition(A=X, B=Z)
move = Move(Geometry=end.End, Motion=expr("-x", addition))  # -> Geometry, Transform
ln = Line(StartPoint=end.Start, EndPoint=move.Geometry)
number_slider = Slider(100, range=0..100)
flip = FlipCurve(Curve=ln)  # -> Curve, Flag
filter = StreamFilter(Gate=flipcurve, Stream0=ln, Stream1=flip.Curve)
beam = CTBeam(Centerline=filter, Width=Slider(100, range=0..100), Height=Slider(100, range=0..100))  # -> Beam, Blank; inputs Centerline: list, ZVector: list of Vector3d, Width: list, Height: list, Category: list, updateRefObj: Boolean
#   port Centerline: Referenced curve or line, Guid of curve or line in the active Rhino document.
#   port ZVector: Vector defining the orientation of the cross-section (corresponds to the height dimension). If None, a default will be taken.
#   port Width: Width of the cross-section (usually the smaller dimension).
#   port Height: Height of the cross-section (usually the larger dimension).
#   port Category: Category of a beam.
#   port updateRefObj: (optional) If True, the attributes in the referenced object will be updated/overwritten with the new values given here.
#   port Beam: Beam object(s).
#   port Blank: Shape of the beam's blank.
# ---------- beam: Python ----------
"""Creates a Beam from a LineCurve."""

import rhinoscriptsyntax as rs
from compas.scene import Scene
from compas_rhino.conversions import line_to_compas
from compas_rhino.conversions import vector_to_compas
from ghpythonlib.componentbase import executingcomponent as component
from Grasshopper.Kernel.GH_RuntimeMessageLevel import Error
from Grasshopper.Kernel.GH_RuntimeMessageLevel import Warning
from Rhino.RhinoDoc import ActiveDoc

from compas_timber.elements import Beam as CTBeam
from compas_timber.ghpython.rhino_object_name_attributes import update_rhobj_attributes_name


class Beam_fromCurve(component):
    def RunScript(self, centerline, z_vector, width, height, category, updateRefObj):
        # minimum inputs required
        if not centerline:
            self.AddRuntimeMessage(Warning, "Input parameter 'Centerline' failed to collect data")
        if not width:
            self.AddRuntimeMessage(Warning, "Input parameter 'Width' failed to collect data")
        if not height:
            self.AddRuntimeMessage(Warning, "Input parameter 'Height' failed to collect data")

        # reformat unset parameters for consistency
        if not z_vector:
            z_vector = [None]
        if not category:
            category = [None]

        beams = []
        blanks = []
        scene = Scene()

        if centerline and height and width:
            # check list lengths for consistency
            N = len(centerline)
            if len(z_vector) not in (0, 1, N):
                self.AddRuntimeMessage(
                    Error, " In 'ZVector' I need either none, one or the same number of inputs as the Crv parameter."
                )
            if len(width) not in (1, N):
                self.AddRuntimeMessage(
                    Error, " In 'W' I need either one or the same number of inputs as the Crv parameter."
                )
            if len(height) not in (1, N):
                self.AddRuntimeMessage(
                    Error, " In 'H' I need either one or the same number of inputs as the Crv parameter."
                )
            if len(category) not in (0, 1, N):
                self.AddRuntimeMessage(
                    Error, " In 'Category' I need either none, one or the same number of inputs as the Crv parameter."
                )

            # duplicate data if None or single value
            if len(z_vector) != N:
                z_vector = [z_vector[0] for _ in range(N)]
            if len(width) != N:
                width = [width[0] for _ in range(N)]
            if len(height) != N:
                height = [height[0] for _ in range(N)]
            if len(category) != N:
                category = [category[0] for _ in range(N)]

            for line, z, w, h, c in zip(centerline, z_vector, width, height, category):
                guid, geometry = self._get_guid_and_geometry(line)
                rhino_line = rs.coerceline(geometry)
                line = line_to_compas(rhino_line)

                z = vector_to_compas(z) if z else None
                beam = CTBeam.from_centerline(centerline=line, width=w, height=h, z_vector=z)
                beam.attributes["rhino_guid"] = str(guid) if guid else None
                beam.attributes["category"] = c
                print(guid)
                if updateRefObj and guid:
                    update_rhobj_attributes_name(guid, "width", str(w))
                    update_rhobj_attributes_name(guid, "height", str(h))
                    update_rhobj_attributes_name(guid, "zvector", str(list(beam.frame.zaxis)))
                    update_rhobj_attributes_name(guid, "category", c)

                beams.append(beam)
                scene.add(beam.blank)

        blanks = scene.draw()

        return beams, blanks

    def _get_guid_and_geometry(self, line):
        # internalized curves and GH geometry will not have persistent GUIDs, referenced Rhino objects will
        # type hint on the input has to be 'ghdoc' for this to work
        guid = None
        geometry = line
        rhino_obj = ActiveDoc.Objects.FindId(line)
        if rhino_obj:
            guid = line
            geometry = rhino_obj.Geometry
        return guid, geometry
# ---------- end beam ----------
beam_2 = CTBeam(Centerline=crv_2, Width=number_slider, Height=number_slider)  # -> Beam, Blank; inputs Centerline: list, ZVector: list of Vector3d, Width: list, Height: list, Category: list, updateRefObj: Boolean; same code as beam

# ---- group: Ref_Side
number_slider_2 = Slider(2, range=0..15)
number_slider_3 = Slider(0, range=0..5)

# ---- group: StepShape
number_slider_4 = Slider(30, range=0..200)
number_slider_5 = Slider(0, range=0..200)
tapered_heel = BooleanToggle(True)

# ---- group: Tenon/Mortise
tenon_mortise_height = Slider(0, range=0..100)

# ----
# StepJoint
python = GhPythonScript(
    cross_beam=beam_2.Beam,
    main_beam=beam.Beam,
    index=number_slider_2,
    ref_side_index=number_slider_3,
    step=number_slider_4,
    heel=number_slider_5,
    tapered=tapered_heel,
    tenon_height=tenon_mortise_height)  # -> out, step_joint, rg_cutting_plane, rg_planes, rg_ref_side, rg_geometry, btlx_params; inputs index: Int32, ref_side_index: Int32; disabled
# ---------- python: Python ----------
import compas
from compas_rhino.conversions import surface_to_rhino
from compas_timber._fabrication import StepJointNotch
from compas_timber._fabrication import StepJointNotchParams
from compas_timber._fabrication import StepJoint
from compas_timber._fabrication import StepJointParams

from compas_timber.model import TimberModel
from compas_timber.fabrication import BTLx

from compas_rhino import unload_modules
from compas.scene import SceneObject

from compas_rhino.conversions import frame_to_rhino, plane_to_rhino, surface_to_rhino, polyline_to_rhino, brep_to_rhino, mesh_to_rhino

import Rhino.Geometry as rg
unload_modules("compas_timber")

#define beam and cutting plane
beam = main_beam
geo = beam.compute_geometry(False)
plane = cross_beam.ref_sides[index]

#create step_joint
step_joint = StepJoint.from_plane_and_beam(plane, beam, step, heel, tapered, ref_side_index)
cutting_planes = step_joint.planes_from_params_and_beam(beam)
print("Orientation: ", step_joint.orientation)
print("StrutInclination: ", step_joint.strut_inclination)

#add tenon
if tenon_height > 0:
    step_joint.add_tenon(cross_beam.width/4, tenon_height)
    tenon_volume = step_joint.tenon_volume_from_params_and_beam(beam)
    tenon_volume = brep_to_rhino(tenon_volume)

#apply geometric features
geometry = step_joint.apply(geo, beam)
rg_geometry = brep_to_rhino(geometry)
rg_geometry.MergeCoplanarFaces(0.01)

#get btlx params
step_joint_params = StepJointParams(step_joint).as_dict()
btlx_params = []
for key, value in step_joint_params.items():
    btlx_params.append("{0}: {1}".format(key, value))

#vizualize in rhino
rg_ref_side = frame_to_rhino(beam.ref_sides[ref_side_index])
rg_cutting_plane = frame_to_rhino(plane)
rg_planes = (plane_to_rhino(plane) for plane in cutting_planes)
# ---------- end python ----------
panel = Panel(python.out)
btlx_params = Panel(python.btlx_params)

# ----
# StepJointNotch
python_2 = GhPythonScript(
    cross_beam=beam_2.Beam,
    main_beam=beam.Beam,
    index=number_slider_3,
    ref_side_index=number_slider_2,
    step=number_slider_4,
    heel=number_slider_5,
    tapered=tapered_heel,
    mortise_height=tenon_mortise_height)  # -> out, step_joint_notch, rg_cutting_plane, rg_planes, rg_ref_side, rg_geometry, btlx_params; inputs index: Int32, ref_side_index: Int32; disabled
# ---------- python_2: Python ----------
from compas_rhino.conversions import surface_to_rhino
from compas_timber._fabrication import StepJointNotch
from compas_timber._fabrication import StepJointNotchParams

from compas_timber.model import TimberModel
from compas_timber.fabrication import BTLx

from compas_rhino import unload_modules
from compas.scene import SceneObject

from compas_rhino.conversions import frame_to_rhino, plane_to_rhino, surface_to_rhino, polyline_to_rhino, brep_to_rhino

import Rhino.Geometry as rg
unload_modules("compas_timber")

#define beam and cutting plane
beam = cross_beam
plane = main_beam.ref_sides[index]

#create step_joint_notch
step_joint_notch = StepJointNotch.from_plane_and_beam(plane, beam, start_y=0.0, notch_limited=False, step_depth=step, heel_depth=heel, strut_height=100.0, tapered_heel=tapered, ref_side_index=ref_side_index)
cutting_planes = step_joint_notch.planes_from_params_and_beam(beam)

print("Orientation: ", step_joint_notch.orientation)
print("StrutInclination: ", step_joint_notch.strut_inclination)

#add mortise
if mortise_height > 0:
    step_joint_notch.add_mortise(beam.width/4, mortise_height, beam)
    mortise_brep = step_joint_notch.mortise_volume_from_params_and_beam(beam)
    mortise_brep = brep_to_rhino(mortise_brep)

#apply geometric features
geo = beam.compute_geometry(False)
geometry = step_joint_notch.apply(geo, beam)
rg_geometry = brep_to_rhino(geometry)

#get btlx params
step_joint_notch_params = StepJointNotchParams(step_joint_notch).as_dict()
btlx_params = []
for key, value in step_joint_notch_params.items():
    btlx_params.append("{0}: {1}".format(key, value))

#vizualize in rhino
rg_ref_side = frame_to_rhino(beam.ref_sides[ref_side_index])
rg_cutting_plane = frame_to_rhino(plane)
rg_planes = (plane_to_rhino(plane) for plane in cutting_planes)
# ---------- end python_2 ----------
panel_2 = Panel(python_2.out)
btlx_params_2 = Panel(python_2.btlx_params)

# ---- group: GEOMETRY
brep = Brep(python.rg_geometry)
swatch = ColourSwatch(SwatchColor=RGBA(0, 102, 255, 29))
edges = BrepEdges(Brep=brep)  # -> Naked, Interior, NonManifold
previewlw = CustomPreviewLineweights(Geometry=edges.Interior, Shader=swatch, Absolute=False)
preview = CustomPreview(Geometry=brep, Material=swatch)

brep_2 = Brep(python_2.rg_geometry)
swatch_2 = ColourSwatch(SwatchColor=RGBA(240, 180, 137, 34))
edges_2 = BrepEdges(Brep=brep_2)  # -> Naked, Interior, NonManifold
preview_2 = CustomPreview(Geometry=brep_2, Material=swatch_2)
previewlw_2 = CustomPreviewLineweights(Geometry=edges_2.Interior, Shader=swatch_2, Absolute=False)

# ---- group: CUTTING PLANE
pln = Plane(python.rg_cutting_plane)

# ---- group: REF_SIDE
pln_2 = Plane(python.rg_ref_side)

# ---- group: CUTTING PLANE
pln_3 = Plane(python_2.rg_cutting_plane)

# ---- group: notch_planes
pln_4 = Plane(python.rg_planes)

# ---- group: REF_SIDE
pln_5 = Plane(python_2.rg_ref_side)

# ---- group: notch_planes
pln_6 = Plane(python_2.rg_planes)

# ----
item = ListItem(List=pln_6, Index=0, Wrap=True)

# ----
# TStepJoint
python_3 = GhPythonScript(
    cross_beam=beam_2.Beam,
    main_beam=beam.Beam,
    step_depth=number_slider_4,
    heel_depth=number_slider_5,
    tapered_heel=tapered_heel,
    tenon_mortise_height=tenon_mortise_height)  # -> out, timber_model, geometry, BTLx
# ---------- python_3: Python ----------
from compas_timber.connections import TStepJoint

from compas_timber.model import TimberModel
from compas_timber.fabrication import BTLx

from compas_rhino.conversions import brep_to_rhino

from compas_rhino import unload_modules

unload_modules("compas_timber")

# Instantiate TimberModel & Add Beams
timber_model = TimberModel()
beams = [cross_beam, main_beam]
for beam in beams:
    timber_model.add_beam(beam)

# Create TStepJoint joint
step_joint_joint = TStepJoint.create(
    timber_model,
    main_beam,
    cross_beam,
    step_depth=step_depth,
    heel_depth=heel_depth,
    tapered_heel=tapered_heel,
    tenon_mortise_height=tenon_mortise_height
    )

# Generate Geometry
geometry = [brep_to_rhino(beam.compute_geometry()) for beam in timber_model.beams]

# Write BTLx
btlx = BTLx(timber_model)
BTLx = btlx.btlx_string()
# ---------- end python_3 ----------
panel_3 = Panel(python_3.out)

panel_4 = Panel(python_3.BTLx)

# ---- group: GEOMETRY
brep_3 = Brep(python_3.geometry)
entwine = Entwine(
    Branch00=ColourSwatch(SwatchColor=RGBA(0, 102, 255, 29)),
    Branch01=ColourSwatch(SwatchColor=RGBA(240, 180, 137, 34)),
    FlattenInputs=True)
edges_3 = BrepEdges(Brep=brep_3)  # -> Naked, Interior, NonManifold
previewlw_3 = CustomPreviewLineweights(Geometry=edges_3.Interior, Shader=graft(entwine), Absolute=False)
preview_3 = CustomPreview(Geometry=brep_3, Material=flatten(entwine))

# ----
panel_5 = Panel("""300
300
600""")
bakewithboxmap = CTBakeWithBoxMap(Model=python_3.timber_model, MapSize=panel_5, Bake=Toggle(True))  # inputs MapSize: list, Bake: Boolean
#   port Model: Model object (optional).
# ---------- bakewithboxmap: Python ----------
# flake8: noqa
import math
import random

import rhinoscriptsyntax as rs
from compas_rhino.conversions import frame_to_rhino
from ghpythonlib.componentbase import executingcomponent as component
from Grasshopper.Kernel.GH_RuntimeMessageLevel import Error
from Grasshopper.Kernel.GH_RuntimeMessageLevel import Warning
from Rhino import Render
from Rhino.Geometry import Interval
from Rhino.Geometry import Plane
from Rhino.RhinoDoc import ActiveDoc


class BakeBoxMap(component):
    def RunScript(self, model, map_size, bake):
        if map_size and len(map_size) != 3:
            self.AddRuntimeMessage(
                Error, "Input parameter MapSize requires exactly three float values (scale factors in x,y,z directions)"
            )
            return

        if map_size:
            dimx, dimy, dimz = map_size
        else:
            # for the pine 251 material bitmap, rotated
            dimx = 0.2
            dimy = 0.2
            dimz = 1.0

        if not model:
            self.AddRuntimeMessage(Warning, "Input parameters Model failed to collect any Beam objects.")
            return

        if not bake:
            return

        try:
            frames = [frame_to_rhino(b.frame) for b in model.beams]
            breps = [beam.geometry.native_brep for beam in model.beams]

            if frames and breps:
                rs.EnableRedraw(False)

                for brep, frame in zip(breps, frames):
                    guid = ActiveDoc.Objects.Add(brep)
                    boxmap = self.create_box_map(frame, dimx, dimy, dimz)
                    ActiveDoc.Objects.ModifyTextureMapping(guid, 1, boxmap)
        finally:
            rs.EnableRedraw(True)

    @staticmethod
    def create_box_map(pln, sx, sy, sz):
        """
        pln: frame of beam box, where x=main axis, y=width, z=height
        sx,sy,sz: box map size in x,y,z direction
        """

        v = pln.YAxis
        w = pln.ZAxis
        pt = pln.Origin

        # random deviation
        a = math.pi * 0.5
        randangle = (random.random() - 0.5) * a
        v.Rotate(randangle, pln.XAxis)

        b = math.pi * 0.01
        randangle = (random.random() - 0.5) * b
        w.Rotate(randangle, pln.XAxis)

        randpos = sx * random.random()
        pt += pln.XAxis * randpos

        # create box mapping
        mappingPln = Plane(pt, w, v)
        dx = Interval(-sx * 0.5, sx * 0.5)
        dy = Interval(-sy * 0.5, sy * 0.5)
        dz = Interval(-sz * 0.5, sz * 0.5)

        BoxMap = Render.TextureMapping.CreateBoxMapping(mappingPln, dx, dy, dz, False)

        return BoxMap
# ---------- end bakewithboxmap ----------
